# Grasshopper definition test.gh (Grasshopper 0.9.76)
# plug-ins: Python Interpreter

brep = Brep([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])

panel = Panel("""20
60
20""")
panel_2 = Panel("""0.1
0.3
0.6""")
seggrading = Butterfly_SegmentGrading(percentageLength=panel_2, percentageCells=panel, expansionRatio=1)  # -> segmentGrading; plug-in component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
multigrading = Butterfly_MultiGrading(segmentGradings=flatten(seggrading))  # -> grading; plug-in component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
gradxyz = Butterfly_GradingXYZ(xGrading=1, yGrading=multigrading, zGrading=1)  # -> gradXYZ; plug-in component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
panel_3 = Panel(gradxyz)
meshparams = Butterfly_MeshingParameters(cellSizeXYZ="{5,15,10}", gradXYZ=gradxyz, globRefineLevel="(2, 2)")  # -> readMe, meshPars; plug-in component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

# ---- group: create refinement region
number_slider = Slider(1.5, range=0..10)
bbox = BoundingBox(Content=brep, Plane=PlaneXY(0, 0, 0), UnionBox=True)  # -> Box, Box_2
area = Area(Geometry=bbox.Box)  # -> Area, Centroid
project = Project(Geometry=area.Centroid, Plane=PlaneXY(0, 0, 0))  # -> Geometry, Transform
scale_nu = ScaleNU(Geometry=bbox.Box, Plane=project.Geometry, ScaleX=number_slider, ScaleY=number_slider, ScaleZ=number_slider)  # -> Geometry, Transform

# ----
wall = Butterfly_WallBoundary(refLevels="(1, 4)")  # -> wallBoundary; plug-in component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

inoutrefmode = Butterfly_LocationRefinementMode(mode=0, level="4")  # -> locationRefMode; plug-in component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
settings_speed = SettingsSpeed()
refinementregion = Butterfly_RefinementRegion(name="refregion", geo=flatten(scale_nu.Geometry), refMode=inoutrefmode, meshSet=settings_speed)  # -> out, refinementRegion; plug-in component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

brep_wireframe = BrepWireframe(Brep=scale_nu.Geometry, Density=-1)
settings_speed_2 = SettingsSpeed()
createbfgeometry = Butterfly_CreateButterflyGeometry(name="building", geo=flatten(brep), boundary=wall, meshSet=settings_speed_2)  # -> out, BFGeometries; plug-in component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

# ---- group: create test surface in pedestrian level
debrep = DeconstructBrep(Brep=scale_nu.Geometry)  # -> Faces, Edges, Vertices
item = ListItem(List=debrep.Faces, Index=4, Wrap=True)
Z = UnitZ(Factor="1.2")
xy = XYPlane(Origin=Z)
move = Move(Geometry=item, Motion=Z)  # -> Geometry, Transform
wires = BrepWireframe(Brep=move.Geometry, Density=-1)
sec = BrepPlane(Brep=brep, Plane=xy)  # -> Curves, Points
join = JoinCurves(Curves=wires, Preserve=False)
boundary = BoundarySurfaces(Edges=flatten([join, sec.Curves]))

# ----
windvector = Butterfly_WindVector(windSpeed=Slider(5, range=0..10), windDirection=Point(0, 1, 0))  # -> windVector; plug-in component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
windtunnelpar = Butterfly_WindTunnelParameters(windwardX=3, topX="2", sidesX=2, leewardX=15)  # -> out, tunnelPar; plug-in component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
createcasefromtunnel = Butterfly_CreateCaseFromTunnel(
    name="test",
    BFGeometries=flatten(createbfgeometry.BFGeometries),
    refRegions=refinementregion.refinementRegion,
    windVector=windvector,
    refWindHeight=10,
    landscape=6,
    meshParams=meshparams.meshPars,
    tunnelPar=windtunnelpar.tunnelPar,
    run=Toggle(False))  # -> out, pts, case; plug-in component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
point = Point(createcasefromtunnel.pts)
blockmesh = Butterfly_blockMesh(case=createcasefromtunnel.case, overwrite=True, run=Toggle(False))  # -> out, case; plug-in component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
panel_4 = Panel("""boundaryField
{

west_window
    {

  
value		uniform (10 0.0 0.0);

}
}""")
brep_2 = Brep(boundary)
gentestpts = Honeybee_GenerateTestPoints(testGeometry=brep_2, gridSize=Slider(1, range=0..1), distBaseSrf="0.05", moveTestMesh=Toggle(False))  # -> readMe, simplify(testPoints), simplify(ptsVectors), simplify(facesArea), simplify(mesh); plug-in component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
decomposepardict = Butterfly_decomposeParDict(mode=0, numOfCpus="6")  # -> decomposeParDict; plug-in component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
panel_5 = Panel("""p
U""")
flatten = FlattenTree(Tree=gentestpts.mesh, Path="{0}")
flatten_2 = FlattenTree(Tree=gentestpts.testPoints, Path="{0}")
snappyhexmesh = Butterfly_snappyHexMesh(case=blockmesh.case, decomposeParDict=decomposepardict, run=Toggle(False))  # -> out, case; plug-in component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
controldict = Butterfly_controlDict(startTime=0, endTime=Slider(1000, range=0..1000), writeInterval=100, writeCompression=False)  # -> controlDict; plug-in component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
solutionparam = Butterfly_SolutionParameter(filename="U", values=panel_4, replace=False)  # -> solutionParam; plug-in component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
probes = Butterfly_probes(pts=flatten_2, fields=panel_5)  # -> probes; plug-in component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
solutionparams = Butterfly_SolutionParameters(controlDict=controldict, probes=probes, additionalParams=solutionparam)  # -> solutionParams; plug-in component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
decomposepardict_2 = Butterfly_decomposeParDict(mode=0, numOfCpus="6")  # -> decomposeParDict; plug-in component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
ras = Butterfly_RASTurbulanceModel(RASModel="RNGkEpsilon", turbulence=True, printCoeffs=True)  # -> RAS; plug-in component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
steadyincomp = Butterfly_SteadyIncompressibleRecipe(turbulenceProp=ras)  # -> out, recipe; plug-in component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
solution = Butterfly_Solution(
    case=snappyhexmesh.case,
    recipe=steadyincomp.recipe,
    decomposeParDict=decomposepardict_2,
    solutionParams=solutionparams,
    interval=2,
    write=Toggle(False),
    run=Toggle(False))  # -> out, solution, isRunning, timestep, residualFields, residualValues, logFiles; plug-in component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
panel_6 = Panel(solution.out)
loadprobesvalue = Butterfly_LoadProbesValue(solution=solution.solution, field="p")  # -> values; plug-in component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
loadprobesvalue_2 = Butterfly_LoadProbesValue(solution=solution.solution, field="U")  # -> values; plug-in component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

# ---- group: points
pt = Point(flatten_2)

# ---- group: vectors
vec = Vector(loadprobesvalue_2)

# ----
mjoin = MeshJoin(Meshes=flatten)
gradientlibrary = Ladybug_GradientLibrary(gradIndex="7")  # -> customColors; plug-in component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
legendpar = Ladybug_LegendParameters(customColors=flatten(gradientlibrary))  # -> legendPar; plug-in component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
subtraction = Subtraction(A=loadprobesvalue, B="273.15")
bnd = Bounds(Numbers=subtraction)
panel_7 = Panel(bnd)
ladybug = Ladybug_Ladybug()  # -> Vviiiiiiiiiizzz; plug-in component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
recolormesh = Ladybug_RecolorMesh(analysisResult=subtraction, inputMesh=mjoin, legendPar=legendpar, analysisTitle="Pressure.", legendTitle="Pa.")  # -> readMe, newMesh, newLegend, legendBasePt, meshColors, legendColors; plug-in component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
scale = Slider(0.44, range=0..1)
faceb = FaceBoundaries(Mesh=recolormesh.newMesh)
mesh = Mesh(recolormesh.newLegend)
multiplication = Multiplication(A=vec, B=scale)
preview = CustomPreview(Geometry=faceb, Shader=recolormesh.meshColors)
vdisex = VectorDisplayEx(Point=pt, Vector=multiplication, Colour=ColourSwatch(SwatchColor=RGBA(39, 34, 25, 142)), Width=Slider(2, range=0..5))
